# Grasshopper definition Dancing_Final.gh (Grasshopper 1.0.7)

# ----
# #GSD6338
# Introduction to Computational Design
# Instructor: Jose Luis García del Castillo y López
# Harvard University Graduate School of Design
panel = Panel("D:\GSD 2022Fall\Introduction_to_Computational_Design\Assignment\assignment[0]\Group 09 - CSV\group09_14.csv")
file = ReadFile(File=panel, PerLineParse=True)

c_script = CSharpScript(CSVData=file)  # -> out, TIMESTAMPS, T0_PLANES, T0_TRIGGER_PRESSED, T0_TRIGGER_CLICKED, T0_TRIGGER_VALUE, T0_TOUCHPAD_PRESSED, T0_TOUCHPAD_CLICKED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; inputs CSVData: list of String
# ---------- c_script: C# usings ----------
using System.IO;
using System.Linq;
using System.Data;
using System.Drawing;
using System.Reflection;
using System.Windows.Forms;
using System.Xml;
using System.Xml.Linq;
using System.Runtime.InteropServices;

using Rhino.DocObjects;
using Rhino.Collections;
using GH_IO;
using GH_IO.Serialization;
# ---------- c_script: C# ----------
    List<long> timestamps = new List<long>();

    List<Plane> t0_planes = new List<Plane>();
    List<bool> t0_trigger_pressed = new List<bool>();
    List<bool> t0_trigger_clicked = new List<bool>();
    List<double> t0_trigger_value = new List<double>();
    List<bool> t0_touchpad_pressed = new List<bool>();
    List<bool> t0_touchpad_clicked = new List<bool>();
    List<Vector3d> t0_touchpad_vectors = new List<Vector3d>();

    List<Plane> t1_planes = new List<Plane>();
    List<bool> t1_trigger_pressed = new List<bool>();
    List<bool> t1_trigger_clicked = new List<bool>();
    List<double> t1_trigger_value = new List<double>();
    List<bool> t1_touchpad_pressed = new List<bool>();
    List<bool> t1_touchpad_clicked = new List<bool>();
    List<Vector3d> t1_touchpad_vectors = new List<Vector3d>();


    // Iterate over all the string in the incoming data list, one per line.
 
    for (int i = 1; i < CSVData.Count; i++) {
      // Retrieve a line will all the data
      string dataRow = CSVData[i];

      
      string[] cols = dataRow.Split(',');  // notice how we use single quotes to indicate a char input

      timestamps.Add(Convert.ToInt64(cols[0]));

      Plane pl0 = new Plane(
        new Point3d(Convert.ToDouble(cols[1]), Convert.ToDouble(cols[2]), Convert.ToDouble(cols[3])),
        new Vector3d(Convert.ToDouble(cols[4]), Convert.ToDouble(cols[5]), Convert.ToDouble(cols[6])),
        new Vector3d(Convert.ToDouble(cols[7]), Convert.ToDouble(cols[8]), Convert.ToDouble(cols[9]))
        );
      t0_planes.Add(pl0);

      t0_trigger_pressed.Add(Convert.ToBoolean(cols[10]));
      t0_trigger_clicked.Add(Convert.ToBoolean(cols[11]));
      t0_trigger_value.Add(Convert.ToDouble(cols[12]));

      t0_touchpad_pressed.Add(Convert.ToBoolean(cols[13]));
      t0_touchpad_clicked.Add(Convert.ToBoolean(cols[14]));

      Vector3d tpv0 = new Vector3d(Convert.ToDouble(cols[15]), Convert.ToDouble(cols[16]), 0);
      t0_touchpad_vectors.Add(tpv0);

      Plane pl1 = new Plane(
        new Point3d(Convert.ToDouble(cols[17]), Convert.ToDouble(cols[18]), Convert.ToDouble(cols[19])),
        new Vector3d(Convert.ToDouble(cols[20]), Convert.ToDouble(cols[21]), Convert.ToDouble(cols[22])),
        new Vector3d(Convert.ToDouble(cols[23]), Convert.ToDouble(cols[24]), Convert.ToDouble(cols[25]))
        );
      t1_planes.Add(pl1);

      t1_trigger_pressed.Add(Convert.ToBoolean(cols[26]));
      t1_trigger_clicked.Add(Convert.ToBoolean(cols[27]));
      t1_trigger_value.Add(Convert.ToDouble(cols[28]));

      t1_touchpad_pressed.Add(Convert.ToBoolean(cols[29]));
      t1_touchpad_clicked.Add(Convert.ToBoolean(cols[30]));

      Vector3d tpv1 = new Vector3d(Convert.ToDouble(cols[31]), Convert.ToDouble(cols[32]), 0);
      t1_touchpad_vectors.Add(tpv1);



    }


    TIMESTAMPS = timestamps;

    T0_PLANES = t0_planes;
    T0_TRIGGER_PRESSED = t0_trigger_pressed;
    T0_TRIGGER_CLICKED = t0_trigger_clicked;
    T0_TRIGGER_VALUE = t0_trigger_value;
    T0_TOUCHPAD_PRESSED = t0_touchpad_pressed;
    T0_TOUCHPAD_CLICKED = t0_touchpad_clicked;
    T0_TOUCHPAD_VECTORS = t0_touchpad_vectors;

    T1_PLANES = t1_planes;
    T1_TRIGGER_PRESSED = t1_trigger_pressed;
    T1_TRIGGER_CLICKED = t1_trigger_clicked;
    T1_TRIGGER_VALUE = t1_trigger_value;
    T1_TOUCHPAD_PRESSED = t1_touchpad_pressed;
    T1_TOUCHPAD_CLICKED = t1_touchpad_clicked;
    T1_TOUCHPAD_VECTORS = t1_touchpad_vectors;
# ---------- end c_script ----------
c_script_2 = CSharpScript(
    t0_plane=c_script.T0_PLANES,
    t1_plane=c_script.T1_PLANES,
    Length=Slider(0.3, range=0..1),
    Height=Slider(0.01, range=0..1),
    Radius=Slider(0.062, range=0..1),
    Difference=Slider(1.15, range=0..10))  # -> Point, VertiLine1, VertiLine2, Ribbon, Curve1, Curve2, C0, C1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; inputs t0_plane: list of Plane, t1_plane: list of Plane, Length: Double, Height: Double, Difference: Double
# ---------- c_script_2: C# ----------
    List<Point3d> originpoint0 = new List<Point3d>();
    List<double> Speed0 = new List<double>();
    List<Vector3d> normal0 = new List<Vector3d>();
    List<Line> vertiline0 = new List<Line>();
    List<Point3d> Start0 = new List<Point3d>();
    List<Point3d> End0 = new List<Point3d>();

    List<Point3d> originpoint1 = new List<Point3d>();
    List<double> Speed1 = new List<double>();
    List<Vector3d> normal1 = new List<Vector3d>();
    List<Line> vertiline1 = new List<Line>();
    List<Point3d> Start1 = new List<Point3d>();
    List<Point3d> End1 = new List<Point3d>();

    int count1 = 0;


    for(int i = 0; i < t0_plane.Count - 1; i++){
      Point3d ori0 = t0_plane[i].Origin;
      Point3d ori1 = t0_plane[i + 1].Origin;
      Vector3d nor = t0_plane[i].ZAxis;
      double speed0 = ori0.DistanceTo(ori1);
      originpoint0.Add(ori0);
      normal0.Add(nor);
      Speed0.Add(speed0);
      Vector3d extend = Length * nor * speed0;
      Point3d start = ori0 + extend;
      Point3d end = ori0 - extend;
      Start0.Add(start);
      End0.Add(end);
      Line line0 = new Line(start, end);
      vertiline0.Add(line0);
      count1 = count1 + 1;

    }

    for(int i = 0; i < t1_plane.Count - 1; i++){
      Point3d ori0 = t1_plane[i].Origin;
      Point3d ori1 = t1_plane[i + 1].Origin;
      Vector3d nor = t1_plane[i].ZAxis;
      double speed0 = ori0.DistanceTo(ori1);
      originpoint1.Add(ori0);
      normal1.Add(nor);
      Speed1.Add(speed0);
      Vector3d extend = Length * nor * speed0;
      Point3d start = ori0 + extend;
      Point3d end = ori0 - extend;
      Start1.Add(start);
      End1.Add(end);
      Line line1 = new Line(start, end);
      vertiline1.Add(line1);

    }

    VertiLine1 = vertiline0;
    VertiLine2 = vertiline1;
    Curve curve1 = Curve.CreateInterpolatedCurve(originpoint0, 3);
    Curve curve2 = Curve.CreateInterpolatedCurve(originpoint1, 3);
    Curve1 = curve1;
    Curve2 = curve2;

    List<int> sync = new List<int>();
    List<Brep> Sticks = new List<Brep>();
    List<Line> upboth = new List<Line>();
    Brep stick = new Brep();
    List<Surface> Inter = new List<Surface>();


    for(int i = 0; i < t0_plane.Count - 1; i++){
      int close = normal0[i].IsParallelTo(normal1[i], Difference);
      sync.Add(close);
      if (close == 1 || close == -1){
        Point3d top0 = t0_plane[i].Origin + normal0[i] * Height;
        Line upline0 = new Line(t0_plane[i].Origin, top0);
        Point3d top1 = t1_plane[i].Origin + normal1[i] * Height;
        Line upline1 = new Line(t1_plane[i].Origin, top1);
        Surface inter1 = NurbsSurface.CreateFromCorners(t0_plane[i].Origin, top0, top1, t1_plane[i].Origin);
        Inter.Add(inter1);
      }


    }

    List<Line> texture0 = new List<Line>();
    List<Line> texture1 = new List<Line>();

    for (int i = 0; i < End0.Count; i++){
      Line text0 = new Line(Start0[i], End0[i]);
      Line text1 = new Line(Start1[i], End1[i]);
      texture0.Add(text0);
      texture1.Add(text1);

    }

    Text0 = texture0;
    Text1 = texture1;
    Point_0 = Start0;
    Point_1 = Start1;
    

    Ribbon = Sticks;

    A = t0_plane.Count;
    B = t1_plane.Count;
    C = Inter;
# ---------- end c_script_2 ----------

c_script_3 = CSharpScript(t0_plane=c_script.T0_PLANES, t1_plane=c_script.T1_PLANES, Dis1=Slider(1.3, range=0..10), Dis2=Slider(1, range=0..10))  # -> out, A, B; inputs t0_plane: Plane, t1_plane: Plane, Dis1: Double, Dis2: Double
# ---------- c_script_3: C# ----------
    Point3d p0 = t0_plane.Origin;
    Point3d p1 = new Point3d(p0.X, p0.Y, Dis1);

    Point3d p2 = t1_plane.Origin;
    Point3d p3 = new Point3d(p2.X, p2.Y, Dis2);

    Line M1 = new Line(p0, p1);
    Line M2 = new Line(p2, p3);



    A = M1;
    B = M2;
# ---------- end c_script_3 ----------
geo = Geometry(c_script_3.A)
geo_2 = Geometry(c_script_3.B)
loft = Loft(Curves=geo, Options={Adjust=False, Closed=False, LoftEnds=0, LoftSimp=0, LoftType=0, Rebuild=10, Refit=0.01})
loft_2 = Loft(Curves=geo_2, Options={Adjust=False, Closed=False, LoftEnds=0, LoftSimp=0, LoftType=0, Rebuild=10, Refit=0.01})
preview = CustomPreview(Geometry=loft, Material=ColourSwatch(SwatchColor=RGB(215, 73, 255)))
preview_2 = CustomPreview(Geometry=loft_2, Material=ColourSwatch(SwatchColor=RGB(89, 189, 255)))

number_slider = Slider(0.005, range=0..0.01)
number_slider_2 = Slider(2, range=0..10)
line = Line(c_script_2.Text1)
line_2 = Line(c_script_2.Text0)
pipe = Pipe(Curve=line, Radius=number_slider, Caps=number_slider_2)
pipe_2 = Pipe(Curve=line_2, Radius=number_slider, Caps=number_slider_2)
colour = ColourPicker(PickedColour=RGB(114, 174, 161))
colour_2 = ColourPicker(PickedColour=RGB(187, 121, 92))
preview_3 = CustomPreview(Geometry=pipe, Material=colour_2)
preview_4 = CustomPreview(Geometry=pipe_2, Material=colour)

geo_3 = Geometry(c_script_2.VertiLine1)
geo_4 = Geometry(c_script_2.VertiLine2)
number_slider_3 = Slider(62, range=0..100)
loft_3 = Loft(Curves=geo_3, Options={Adjust=False, Closed=False, LoftEnds=0, LoftSimp=0, LoftType=0, Rebuild=10, Refit=0.01})
loft_4 = Loft(Curves=geo_4, Options={Adjust=False, Closed=False, LoftEnds=0, LoftSimp=0, LoftType=0, Rebuild=10, Refit=0.01})
swatch = ColourSwatch(SwatchColor=RGB(215, 74, 255))
divide = DivideDomain²(Domain=loft_4, UCount=Slider(10, range=0..100), VCount=number_slider_3)
swatch_2 = ColourSwatch(SwatchColor=RGB(86, 75, 255))
recgrid = Rectangular(Plane=PlaneXY(0, 0, 0), SizeX=number_slider_3, SizeY=number_slider_3, ExtentX=10, ExtentY=5)  # -> Cells, flatten(Points)
srf = Surface(reparameterize(loft_4))
subsrf = Isotrim(Surface=loft_4, Domain=divide)
area = Area(Geometry=subsrf)  # -> Area, Centroid
evalsrf = EvaluateSurface(Surface=srf, Point=recgrid.Points)  # -> Point, Normal, UDirection, VDirection, Frame
bnd = Bounds(Numbers=evalsrf.UDirection)
dedomain = DeconstructDomain(Domain=bnd)  # -> Start, End
gradient = Gradient(
    LowerLimit=dedomain.Start,
    UpperLimit=dedomain.End,
    Parameter=evalsrf.UDirection,
    stops=[0: RGB(243, 57, 0), 0.1: RGB(236, 27, 60), 0.2: RGB(210, 0, 118), 0.3: RGB(103, 0, 120), 0.4: RGB(39, 72, 161), 0.5: RGB(1, 192, 229), 0.6: RGB(18, 178, 90), 0.7: RGB(79, 186, 8), 0.8: RGB(220, 237, 32), 0.9: RGB(247, 159, 20), 1: RGB(243, 57, 0)])
colour_3 = ColourPicker(PickedColour=RGB(114, 174, 161))
preview_5 = CustomPreview(Geometry=loft_3, Material=colour_3)

geo_5 = Geometry(c_script_2.C)
area_2 = Area(Geometry=geo_5)  # -> Area, Centroid
bnd_2 = Bounds(Numbers=area_2.Area)
dedomain_2 = DeconstructDomain(Domain=bnd_2)  # -> Start, End
gradient_2 = Gradient(
    LowerLimit=dedomain_2.Start,
    UpperLimit=dedomain_2.End,
    Parameter=geo_5,
    stops=[0: RGB(234, 38, 0), 0.468: RGB(234, 126, 0), 0.663: RGB(254, 244, 84), 0.851: RGB(173, 203, 249), 1: RGB(75, 107, 169)])
preview_6 = CustomPreview(Geometry=geo_5, Material=gradient_2)
geo_6 = Geometry(geo_5)

colour_4 = ColourPicker(PickedColour=RGB(175, 255, 92))

number_slider_4 = Slider(1, range=0..1)
srf_2 = Surface(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)
dom²num = ConstructDomain²(UMin=0, UMax=number_slider_4, VMin=0, VMax=1)
srf_3 = Surface(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)
dom²num_2 = ConstructDomain²(UMin=0, UMax=number_slider_4, VMin=0, VMax=1)
subsrf_2 = Isotrim(Surface=reparameterize(srf_2), Domain=dom²num_2)
subsrf_3 = Isotrim(Surface=reparameterize(srf_3), Domain=dom²num)
colour_5 = ColourPicker(PickedColour=RGB(114, 174, 161))
colour_6 = ColourPicker(PickedColour=RGB(187, 121, 92))
preview_7 = CustomPreview(Geometry=subsrf_3, Material=colour_6)
preview_8 = CustomPreview(Geometry=subsrf_2, Material=colour_5)

preview_9 = CustomPreview(Geometry=srf, Material=colour_4)
