# Grasshopper definition Mountain_Final.gh (Grasshopper 1.0.7)

# ----
# #GSD6338
# Introduction to Computational Design
# Instructor: Jose Luis García del Castillo y López
# Harvard University Graduate School of Design
panel = Panel("D:\GSD 2022Fall\Introduction_to_Computational_Design\Assignment\assignment[0]\Group 09 - CSV\group09_06.csv")
file = ReadFile(File=panel, PerLineParse=True)

c_script = CSharpScript(CSVData=file)  # -> out, TIMESTAMPS, T0_PLANES, T0_TRIGGER_PRESSED, T0_TRIGGER_CLICKED, T0_TRIGGER_VALUE, T0_TOUCHPAD_PRESSED, T0_TOUCHPAD_CLICKED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; inputs CSVData: list of String
# ---------- c_script: C# usings ----------
using System.IO;
using System.Linq;
using System.Data;
using System.Drawing;
using System.Reflection;
using System.Windows.Forms;
using System.Xml;
using System.Xml.Linq;
using System.Runtime.InteropServices;

using Rhino.DocObjects;
using Rhino.Collections;
using GH_IO;
using GH_IO.Serialization;
# ---------- c_script: C# ----------
    List<long> timestamps = new List<long>();

    List<Plane> t0_planes = new List<Plane>();
    List<bool> t0_trigger_pressed = new List<bool>();
    List<bool> t0_trigger_clicked = new List<bool>();
    List<double> t0_trigger_value = new List<double>();
    List<bool> t0_touchpad_pressed = new List<bool>();
    List<bool> t0_touchpad_clicked = new List<bool>();
    List<Vector3d> t0_touchpad_vectors = new List<Vector3d>();

    List<Plane> t1_planes = new List<Plane>();
    List<bool> t1_trigger_pressed = new List<bool>();
    List<bool> t1_trigger_clicked = new List<bool>();
    List<double> t1_trigger_value = new List<double>();
    List<bool> t1_touchpad_pressed = new List<bool>();
    List<bool> t1_touchpad_clicked = new List<bool>();
    List<Vector3d> t1_touchpad_vectors = new List<Vector3d>();


   
    for (int i = 1; i < CSVData.Count; i++) {
      
      string dataRow = CSVData[i];

      
      string[] cols = dataRow.Split(',');  

      timestamps.Add(Convert.ToInt64(cols[0]));

      Plane pl0 = new Plane(
        new Point3d(Convert.ToDouble(cols[1]), Convert.ToDouble(cols[2]), Convert.ToDouble(cols[3])),
        new Vector3d(Convert.ToDouble(cols[4]), Convert.ToDouble(cols[5]), Convert.ToDouble(cols[6])),
        new Vector3d(Convert.ToDouble(cols[7]), Convert.ToDouble(cols[8]), Convert.ToDouble(cols[9]))
        );
      t0_planes.Add(pl0);

      t0_trigger_pressed.Add(Convert.ToBoolean(cols[10]));
      t0_trigger_clicked.Add(Convert.ToBoolean(cols[11]));
      t0_trigger_value.Add(Convert.ToDouble(cols[12]));

      t0_touchpad_pressed.Add(Convert.ToBoolean(cols[13]));
      t0_touchpad_clicked.Add(Convert.ToBoolean(cols[14]));

      Vector3d tpv0 = new Vector3d(Convert.ToDouble(cols[15]), Convert.ToDouble(cols[16]), 0);
      t0_touchpad_vectors.Add(tpv0);

      Plane pl1 = new Plane(
        new Point3d(Convert.ToDouble(cols[17]), Convert.ToDouble(cols[18]), Convert.ToDouble(cols[19])),
        new Vector3d(Convert.ToDouble(cols[20]), Convert.ToDouble(cols[21]), Convert.ToDouble(cols[22])),
        new Vector3d(Convert.ToDouble(cols[23]), Convert.ToDouble(cols[24]), Convert.ToDouble(cols[25]))
        );
      t1_planes.Add(pl1);

      t1_trigger_pressed.Add(Convert.ToBoolean(cols[26]));
      t1_trigger_clicked.Add(Convert.ToBoolean(cols[27]));
      t1_trigger_value.Add(Convert.ToDouble(cols[28]));

      t1_touchpad_pressed.Add(Convert.ToBoolean(cols[29]));
      t1_touchpad_clicked.Add(Convert.ToBoolean(cols[30]));

      Vector3d tpv1 = new Vector3d(Convert.ToDouble(cols[31]), Convert.ToDouble(cols[32]), 0);
      t1_touchpad_vectors.Add(tpv1);



    }


    TIMESTAMPS = timestamps;

    T0_PLANES = t0_planes;
    T0_TRIGGER_PRESSED = t0_trigger_pressed;
    T0_TRIGGER_CLICKED = t0_trigger_clicked;
    T0_TRIGGER_VALUE = t0_trigger_value;
    T0_TOUCHPAD_PRESSED = t0_touchpad_pressed;
    T0_TOUCHPAD_CLICKED = t0_touchpad_clicked;
    T0_TOUCHPAD_VECTORS = t0_touchpad_vectors;

    T1_PLANES = t1_planes;
    T1_TRIGGER_PRESSED = t1_trigger_pressed;
    T1_TRIGGER_CLICKED = t1_trigger_clicked;
    T1_TRIGGER_VALUE = t1_trigger_value;
    T1_TOUCHPAD_PRESSED = t1_touchpad_pressed;
    T1_TOUCHPAD_CLICKED = t1_touchpad_clicked;
    T1_TOUCHPAD_VECTORS = t1_touchpad_vectors;
# ---------- end c_script ----------
c_script_2 = CSharpScript(t0_plane=c_script.T0_PLANES, t1_plane=c_script.T1_PLANES, Dis1=Slider(1.3, range=0..10), Dis2=Slider(1, range=0..10))  # -> out, A, B; inputs t0_plane: Plane, t1_plane: Plane, Dis1: Double, Dis2: Double
# ---------- c_script_2: C# ----------
    Point3d p0 = t0_plane.Origin;
    Point3d p1 = new Point3d(p0.X, p0.Y, Dis1);

    Point3d p2 = t1_plane.Origin;
    Point3d p3 = new Point3d(p2.X, p2.Y, Dis2);

    Line M1 = new Line(p0, p1);
    Line M2 = new Line(p2, p3);



    A = M1;
    B = M2;
# ---------- end c_script_2 ----------
geo = Geometry(c_script_2.B)
loft = Loft(Curves=geo, Options={Adjust=False, Closed=False, LoftEnds=0, LoftSimp=0, LoftType=0, Rebuild=10, Refit=0.01})
divide = DivideDomain²(Domain=loft, UCount=Slider(1, range=0..100), VCount=Slider(40, range=0..100))
subsrf = Isotrim(Surface=loft, Domain=divide)  # -> simplify(Surface)
area = Area(Geometry=subsrf)  # -> Area, Centroid
pdecon = Deconstruct(Point=area.Centroid)  # -> XComponent, YComponent, ZComponent
bnd = Bounds(Numbers=pdecon.ZComponent)
remap = RemapNumbers(Value=pdecon.ZComponent, Source=bnd, Target=Domain(0, 1))  # -> simplify(Mapped), Clipped
gradient = Gradient(
    LowerLimit=Slider(0, range=0..100),
    UpperLimit=Slider(1, range=0..1),
    Parameter=remap.Mapped,
    stops=[0.00459: RGB(255, 255, 255), 1: RGBA(31, 31, 31, 246)])
preview = CustomPreview(Geometry=subsrf, Material=gradient)
